# Grasshopper definition 20210305_kiss_battery.gh (Grasshopper 1.0.7)

# 1. wall thickness einmal einstellbar
# 2. abstan dkühlkanal auf
# KISS BATTERY
# GRUNDPLATTE OHNE KUEHLKANAL
fräsbauteil_2 = Brep(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)

# ----
# Anzahl Zellen
# Wandstärke
number_slider = Slider(1, range=0..10)
number_slider_2 = Slider(2, range=0..10)

pl_offset = PlaneOffset(BasePlane=PlaneXY(0, 0, 0), Offset=number_slider)
addition = Addition(A=number_slider_2, B=Slider(1, range=0..1))
series = Series(Start=0, Step=1, Count=addition)
rec_2pt = Rectangle2Pt(Plane=pl_offset, PointA="{0, 19, 0}", PointB="{3, 161, 0}", Radius=Slider(1, range=0..1))  # -> Rectangle, Length
number_slider_3 = Slider(46, range=0..100)
rec_2pt_2 = Rectangle2Pt(Plane=pl_offset, PointA="{12, 164, 0}", PointB="{37, 161, 0}", Radius=Slider(1, range=0..1))  # -> Rectangle, Length
multiplication = Multiplication(A=number_slider_3, B=series)
vec = VectorXYZ(XComponent=[multiplication, number_slider_3], YComponent=0, ZComponent=0)  # -> Vector, Length
extr = Extrude(Base=rec_2pt.Rectangle, Direction="{0, 0, 5}")
cap = CapHoles(Brep=extr)
move = Move(Geometry=cap, Motion=vec.Vector)  # -> Geometry, Transform

series_2 = Series(Start=0, Step=1, Count=number_slider_2)
number_slider_4 = Slider(46, range=0..100)
multiplication_2 = Multiplication(A=number_slider_4, B=series_2)
extr_2 = Extrude(Base=rec_2pt_2.Rectangle, Direction="{0, 0, 5}")
vec_2 = VectorXYZ(XComponent=[multiplication_2, number_slider_4], YComponent=0, ZComponent=0)  # -> Vector, Length
cap_2 = CapHoles(Brep=extr_2)
move_2 = Move(Geometry=cap_2, Motion=vec_2.Vector)  # -> Geometry, Transform

# ----
# GRUNDPLATTE MIT KUEHLKANAL
fräsbauteil_1 = Brep(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)

# ----
# Wandstärke
number_slider_5 = Slider(4, range=0..10)

pl_offset_2 = PlaneOffset(BasePlane=PlaneXY(0, 0, 0), Offset=number_slider_5)
addition_2 = Addition(A=number_slider_2, B=Slider(1, range=0..1))
series_3 = Series(Start=0, Step=1, Count=addition_2)
rec_2pt_3 = Rectangle2Pt(Plane=pl_offset_2, PointA="{0, 19, 0}", PointB="{3, 161, 0}", Radius=Slider(1, range=0..1))  # -> Rectangle, Length
number_slider_6 = Slider(46, range=0..100)
rec_2pt_4 = Rectangle2Pt(Plane=pl_offset_2, PointA="{12, 164, 0}", PointB="{37, 161, 0}", Radius=Slider(1, range=0..1))  # -> Rectangle, Length
multiplication_3 = Multiplication(A=number_slider_6, B=series_3)
vec_3 = VectorXYZ(XComponent=[multiplication_3, number_slider_6], YComponent=0, ZComponent=0)  # -> Vector, Length
extr_3 = Extrude(Base=rec_2pt_3.Rectangle, Direction="{0, 0, 5}")
cap_3 = CapHoles(Brep=extr_3)
move_3 = Move(Geometry=cap_3, Motion=vec_3.Vector)  # -> Geometry, Transform

series_4 = Series(Start=0, Step=1, Count=number_slider_2)
number_slider_7 = Slider(46, range=0..100)
multiplication_4 = Multiplication(A=number_slider_7, B=series_4)
extr_4 = Extrude(Base=rec_2pt_4.Rectangle, Direction="{0, 0, 5}")
vec_4 = VectorXYZ(XComponent=[multiplication_4, number_slider_7], YComponent=0, ZComponent=0)  # -> Vector, Length
cap_4 = CapHoles(Brep=extr_4)
move_4 = Move(Geometry=cap_4, Motion=vec_4.Vector)  # -> Geometry, Transform

# ----
# ABSCHLUSSPLATTEN
abschlussplatte = Brep(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)

# ----
# Cut Out
number_slider_8 = Slider(50, range=0..1000)
vec_5 = VectorXYZ(XComponent=number_slider_8, YComponent=Slider(200, range=0..1000), ZComponent=0)  # -> Vector, Length
vec_6 = VectorXYZ(XComponent=0, YComponent=0, ZComponent=Slider(100, range=0..100))  # -> Vector, Length
vec_7 = VectorXYZ(XComponent=0, YComponent=0, ZComponent=Slider(100, range=0..100))  # -> Vector, Length
rev = Reverse(Vector=vec_6.Vector)

circle = CircleCNR(Center="{-5, 130, 0}", Normal=Vector(0, 0, 1), Radius=Slider(3, range=0..20))
circle_2 = CircleCNR(Center="{-5, 130, 0}", Normal=Vector(0, 0, 1), Radius=Slider(7, range=0..20))
circle_3 = CircleCNR(Center="{-8, 150, 0}", Normal=Vector(0, 0, 1), Radius=Slider(4, range=0..20))
circle_4 = CircleCNR(Center="{-8, 150, 0}", Normal=Vector(0, 0, 1), Radius=Slider(11, range=0..20))
xz = XZPlane(Origin="{0, 90, 0}")

# ----
# R1
# R2
panel = Panel("46.375")
multiplication_5 = Multiplication(A=number_slider_2, B=panel)
rectangle = Rectangle(Plane=PlaneXY(0, 0, 0), XSize=multiplication_5, YSize=Slider(180, range=0..1000), Radius=Slider(10, range=0..10))  # -> Rectangle, Length
addition_3 = Addition(A=Slider(12, range=0..100), B=number_slider)
addition_4 = Addition(A=Slider(20, range=0..100), B=number_slider)
addition_5 = Addition(A=Slider(-20, range=-20..100), B=number_slider)
vec_8 = VectorXYZ(XComponent=0, YComponent=0, ZComponent=addition_3)  # -> Vector, Length
vec_9 = VectorXYZ(XComponent=0, YComponent=0, ZComponent=addition_4)  # -> Vector, Length
vec_10 = VectorXYZ(XComponent=0, YComponent=0, ZComponent=addition_5)  # -> Vector, Length
vec_11 = VectorXYZ(XComponent=0, YComponent=0, ZComponent=number_slider)  # -> Vector, Length
extr_5 = Extrude(Base=[circle_3, circle], Direction=vec_10.Vector)
extr_6 = Extrude(Base=rectangle.Rectangle, Direction=vec_11.Vector)
cap_5 = CapHoles(Brep=extr_6)

extr_7 = Extrude(Base=[circle_3, circle], Direction=vec_9.Vector)
extr_8 = Extrude(Base=[circle_4, circle_2, circle_3], Direction=vec_8.Vector)
cap_6 = CapHoles(Brep=[extr_5, extr_7])
cap_7 = CapHoles(Brep=extr_8)

division = Division(A=multiplication_5, B=Slider(2, range=0..10))
vec_12 = VectorXYZ(XComponent=division, YComponent=0, ZComponent=0)  # -> Vector, Length
yz = YZPlane(Origin=vec_12.Vector)

sunion = SolidUnion(Breps=cap_6)
trim = TrimSolid(Shape=cap_7, Cutters=sunion)

cap_8 = CapHoles(Brep=trim)

mirror = Mirror(Geometry=cap_8, Plane=xz)  # -> Geometry, Transform

mirror_2 = Mirror(Geometry=[mirror.Geometry, cap_8], Plane=yz)  # -> Geometry, Transform

# ----
# CAD
sunion_2 = SolidUnion(Breps=[cap_5, move.Geometry, move_2.Geometry])
merge = Merge(Data1=sunion_2, Data2=mirror_2.Geometry, Data3=mirror.Geometry, Data4=cap_8)
pi = Pi(Factor=1)
xz_2 = XZPlane(Origin=Point(0, 0, 0))
rot3d = Rotate3D(Geometry=merge, Angle=pi, Center=Point(0, 0, 0), Axis=xz_2)  # -> Geometry, Transform

number_slider_9 = Slider(50, range=0..100)

# ----
# Cut Out
number_slider_10 = Slider(50, range=0..1000)
vec_13 = VectorXYZ(XComponent=number_slider_10, YComponent=Slider(200, range=0..1000), ZComponent=0)  # -> Vector, Length
vec_14 = VectorXYZ(XComponent=0, YComponent=0, ZComponent=Slider(100, range=0..100))  # -> Vector, Length
vec_15 = VectorXYZ(XComponent=0, YComponent=0, ZComponent=Slider(100, range=0..100))  # -> Vector, Length
rev_2 = Reverse(Vector=vec_14.Vector)

# ----
# Fluidkanal außen
# R1
# R2
# Fluidkanal innen
# Abstand Außenwand
panel_2 = Panel("150")
division_2 = Division(A=panel_2, B="5")
pt = ConstructPoint(XCoordinate="-8", YCoordinate=panel_2, ZCoordinate=0)
pt_2 = ConstructPoint(XCoordinate="-8", YCoordinate=division_2, ZCoordinate=0)
python = GhPythonScript(x=number_slider_5, y=Slider(4, range=0..10))  # -> out, a, b
# ---------- python: Python ----------
__author__ = "Sebastian"
__version__ = "2021.03.04"

import rhinoscriptsyntax as rs

if y >= x:
    y=x/2
    print(y)
else: 
    y=y
    print(y)
# ---------- end python ----------
multiplication_6 = Multiplication(A=number_slider_2, B="46.375")
addition_6 = Addition(A=Slider(12, range=0..100), B=number_slider_5)
addition_7 = Addition(A=Slider(20, range=0..100), B=number_slider_5)
addition_8 = Addition(A=Slider(-20, range=-20..100), B=number_slider_5)
rectangle_2 = Rectangle(Plane=PlaneXY(0, 0, 0), XSize=multiplication_6, YSize=Slider(180, range=0..1000), Radius=Slider(10, range=0..10))  # -> Rectangle, Length
vec_16 = VectorXYZ(XComponent=0, YComponent=0, ZComponent=addition_8)  # -> Vector, Length
vec_17 = VectorXYZ(XComponent=0, YComponent=0, ZComponent=addition_7)  # -> Vector, Length
vec_18 = VectorXYZ(XComponent=0, YComponent=0, ZComponent=addition_6)  # -> Vector, Length
vec_19 = VectorXYZ(XComponent=0, YComponent=0, ZComponent=number_slider_5)  # -> Vector, Length
rev_3 = Reverse(Vector=vec_17.Vector)
extr_9 = Extrude(Base=rectangle_2.Rectangle, Direction=vec_19.Vector)
cap_9 = CapHoles(Brep=extr_9)
sunion_3 = SolidUnion(Breps=[cap_9, move_3.Geometry, move_4.Geometry])

vec_20 = VectorXYZ(XComponent=multiplication_6, YComponent=0, ZComponent=0)  # -> Vector, Length
move_5 = Move(Geometry=rot3d.Geometry, Motion=vec_20.Vector)  # -> Geometry, Transform

subtraction = Subtraction(A=panel_2, B=division_2)
integer_division = IntegerDivision(A=subtraction, B="3")
subtraction_2 = Subtraction(A=panel_2, B=integer_division)
subtraction_3 = Subtraction(A=subtraction_2, B=integer_division)
subtraction_4 = Subtraction(A=multiplication_6, B=number_slider_9)
pt_3 = ConstructPoint(XCoordinate=subtraction_4, YCoordinate=subtraction_2, ZCoordinate=0)
pt_4 = ConstructPoint(XCoordinate=number_slider_9, YCoordinate=subtraction_2, ZCoordinate=0)
pt_5 = ConstructPoint(XCoordinate=number_slider_9, YCoordinate=subtraction_3, ZCoordinate=0)
pt_6 = ConstructPoint(XCoordinate=subtraction_4, YCoordinate=subtraction_3, ZCoordinate=0)
pt_7 = ConstructPoint(XCoordinate=subtraction_4, YCoordinate=division_2, ZCoordinate=0)
vec_21 = VectorXYZ(XComponent=subtraction_4, YComponent=panel_2, ZComponent=0)  # -> Vector, Length
vec_22 = VectorXYZ(XComponent=subtraction_4, YComponent=0, ZComponent=0)  # -> Vector, Length
rev_4 = Reverse(Vector=vec_22.Vector)
pline = PolyLine(Vertices=[pt_7, pt_2], Closed=False)
pline_2 = PolyLine(Vertices=[pt_5, pt_6], Closed=False)
arc = ArcSED(Start=pt_6, End=pt_7, Direction=vec_22.Vector)  # -> Arc, Plane, Radius
pline_3 = PolyLine(Vertices=[pt_3, pt_4], Closed=False)
pline_4 = PolyLine(Vertices=[pt, vec_21.Vector], Closed=False)
arc_2 = ArcSED(Start=pt_4, End=pt_5, Direction=rev_4)  # -> Arc, Plane, Radius
arc_3 = ArcSED(Start=vec_21.Vector, End=pt_3, Direction=vec_22.Vector)  # -> Arc, Plane, Radius
pipe = Pipe(Curve=[arc_3.Arc, pline_3, pline_4, arc_2.Arc, pline_2, arc.Arc, pline], Radius=python.out, Caps=0)

python_2 = GhPythonScript(x=number_slider_2)  # -> out, a
# ---------- python_2: Python ----------
__author__ = "Sebastian"
__version__ = "2021.03.04"

import rhinoscriptsyntax as rs



#print(int(x))
list=range(1, int(x))
#print(list)


for n in list:
    y=n*46.375
    print(y)
# ---------- end python_2 ----------
number_slider_11 = Slider(161, range=0..300)
# POUCH ZELLEN
number_slider_12 = Slider(24.5, range=0..100)
addition_9 = Addition(A=number_slider, B=Slider(6, range=0..10))
panel_3 = Panel(python_2.out)
addition_10 = Addition(A=addition_6, B=Slider(-6, range=-20..10))
matrix = ConstructMatrix(Rows=3, Columns=Slider(1, range=0..1))
multiplication_7 = Multiplication(A=addition_9, B="-1")
vec_23 = VectorXYZ(XComponent=python_2.out, YComponent=0, ZComponent=0)  # -> Vector, Length
vec_24 = VectorXYZ(XComponent=number_slider_12, YComponent=number_slider_11, ZComponent=addition_10)  # -> Vector, Length
panel_4 = Panel(matrix)
vec_25 = VectorXYZ(XComponent=number_slider_12, YComponent=number_slider_11, ZComponent=multiplication_7)  # -> Vector, Length
brep = Brep(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)
move_6 = Move(Geometry=brep, Motion=vec_24.Vector)  # -> Geometry, Transform
move_7 = Move(Geometry=brep, Motion=vec_25.Vector)  # -> Geometry, Transform
move_8 = Move(Geometry=graft([move_6.Geometry, move_7.Geometry]), Motion=vec_23.Vector)  # -> flatten(Geometry), Transform
merge_2 = Merge(Data1=[move_6.Geometry, move_8.Geometry, move_7.Geometry])  # -> graft(Result)

panel_5 = Panel(merge_2)

subtraction_5 = Subtraction(A=multiplication_6, B=number_slider_8)
vec_26 = VectorXYZ(XComponent=subtraction_5, YComponent=Slider(168, range=0..1000), ZComponent=0)  # -> Vector, Length
rec_2pt_5 = Rectangle2Pt(Plane=PlaneXY(0, 0, 0), PointA=vec_5.Vector, PointB=vec_26.Vector, Radius=Slider(5, range=0..10))  # -> Rectangle, Length

subtraction_6 = Subtraction(A=multiplication_6, B=number_slider_10)
vec_27 = VectorXYZ(XComponent=subtraction_6, YComponent=Slider(168, range=0..1000), ZComponent=0)  # -> Vector, Length
rec_2pt_6 = Rectangle2Pt(Plane=PlaneXY(0, 0, 0), PointA=vec_13.Vector, PointB=vec_27.Vector, Radius=Slider(5, range=0..10))  # -> Rectangle, Length

circle_5 = CircleCNR(Center="{-5, 130, 0}", Normal=Vector(0, 0, 1), Radius=Slider(7, range=0..20))
circle_6 = CircleCNR(Center="{-5, 130, 0}", Normal=Vector(0, 0, 1), Radius=Slider(3, range=0..20))
circle_7 = CircleCNR(Center=pt, Normal=Vector(0, 0, 1), Radius=Slider(4, range=0..20))
circle_8 = CircleCNR(Center="{-8, 150, 0}", Normal=Vector(0, 0, 1), Radius=Slider(11, range=0..20))
extr_10 = Extrude(Base=[circle_7, circle_6], Direction=graft([vec_17.Vector, rev_3]))
extr_11 = Extrude(Base=[circle_8, circle_5], Direction=vec_18.Vector)
cap_10 = CapHoles(Brep=extr_11)

extr_12 = Extrude(Base=[circle_7, circle_6], Direction=graft([vec_16.Vector, rev_3]))
pt_8 = ConstructPoint(XCoordinate=0, YCoordinate="90", ZCoordinate=0)

cap_11 = CapHoles(Brep=[extr_12, extr_10])
xz_3 = XZPlane(Origin=pt_8)

mirror_3 = Mirror(Geometry=rec_2pt_5.Rectangle, Plane=xz_3)  # -> Geometry, Transform
extr_13 = Extrude(Base=[mirror_3.Geometry, rec_2pt_5.Rectangle], Direction=graft([rev, vec_7.Vector]))
cap_12 = CapHoles(Brep=extr_13)

sdiff = SolidDifference(BrepsA=graft(move_5.Geometry), BrepsB=flatten(cap_12))  # -> flatten(Result)

sunion_4 = SolidUnion(Breps=sdiff)
panel_6 = Panel(sunion_4)

mirror_4 = Mirror(Geometry=rec_2pt_6.Rectangle, Plane=xz_3)  # -> Geometry, Transform
extr_14 = Extrude(Base=[mirror_4.Geometry, rec_2pt_6.Rectangle], Direction=graft([rev_2, vec_15.Vector]))
cap_13 = CapHoles(Brep=extr_14)

sunion_5 = SolidUnion(Breps=cap_11)  # -> flatten(Result)
sdiff_2 = SolidDifference(BrepsA=cap_10, BrepsB=sunion_5)

mirror_5 = Mirror(Geometry=sdiff_2, Plane=xz_3)  # -> Geometry, Transform

division_3 = Division(A=multiplication_6, B=Slider(2, range=0..10))
vec_28 = VectorXYZ(XComponent=division_3, YComponent=0, ZComponent=0)  # -> Vector, Length
yz_2 = YZPlane(Origin=vec_28.Vector)
mirror_6 = Mirror(Geometry=[mirror_5.Geometry, sdiff_2], Plane=yz_2)  # -> Geometry, Transform

# ----
# CAD
merge_3 = Merge(Data1=sunion_3, Data2=mirror_6.Geometry, Data3=mirror_5.Geometry, Data5=sdiff_2)
capex = CapHolesEx(Brep=pipe)  # -> Brep, Caps, Solid
panel_7 = Panel(merge_3)
sdiff_3 = SolidDifference(BrepsA=graft(merge_3), BrepsB=flatten([capex.Brep, cap_13]))  # -> flatten(Result)

sunion_6 = SolidUnion(Breps=sdiff_3)
panel_8 = Panel(sunion_6)

# ----
# Cut Out
number_slider_13 = Slider(50, range=0..1000)
subtraction_7 = Subtraction(A=multiplication_6, B=number_slider_13)
vec_29 = VectorXYZ(XComponent=number_slider_13, YComponent=Slider(200, range=0..1000), ZComponent=0)  # -> Vector, Length
vec_30 = VectorXYZ(XComponent=subtraction_7, YComponent=Slider(168, range=0..1000), ZComponent=0)  # -> Vector, Length
rec_2pt_7 = Rectangle2Pt(Plane=PlaneXY(0, 0, 0), PointA=vec_29.Vector, PointB=vec_30.Vector, Radius=Slider(5, range=0..10))  # -> Rectangle, Length
mirror_7 = Mirror(Geometry=rec_2pt_7.Rectangle, Plane=xz_3)  # -> Geometry, Transform
vec_31 = VectorXYZ(XComponent=0, YComponent=0, ZComponent=Slider(100, range=0..100))  # -> Vector, Length
vec_32 = VectorXYZ(XComponent=0, YComponent=0, ZComponent=Slider(100, range=0..100))  # -> Vector, Length
rev_5 = Reverse(Vector=vec_31.Vector)
extr_15 = Extrude(Base=[mirror_7.Geometry, rec_2pt_7.Rectangle], Direction=graft([rev_5, vec_32.Vector]))
cap_14 = CapHoles(Brep=extr_15)

pi_2 = Pi(Factor=Slider(1.5, range=0..10))
yz_3 = YZPlane(Origin=Point(0, 0, 0))
# BMS
brep_2 = Brep(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)
rot3d_2 = Rotate3D(Geometry=brep_2, Angle=pi_2, Center=Point(0, 0, 0), Axis=yz_3)  # -> Geometry, Transform
vec_33 = VectorXYZ(XComponent=yz_2, YComponent=Slider(131, range=0..200), ZComponent=Slider(-15, range=-50..100))  # -> Vector, Length
move_9 = Move(Geometry=rot3d_2.Geometry, Motion=vec_33.Vector)  # -> Geometry, Transform

# ----
# Fluidkanal außen
# R1
# R2
number_slider_14 = Slider(2, range=0..10)
division_4 = Division(A="150", B="5")
pt_9 = ConstructPoint(XCoordinate="-8", YCoordinate="150", ZCoordinate=0)
pt_10 = ConstructPoint(XCoordinate="-8", YCoordinate=division_4, ZCoordinate=0)
multiplication_8 = Multiplication(A=number_slider_2, B="46.375")
rectangle_3 = Rectangle(Plane=PlaneXY(0, 0, 0), XSize=multiplication_8, YSize=Slider(180, range=0..1000), Radius=Slider(10, range=0..10))  # -> Rectangle, Length
vec_34 = VectorXYZ(XComponent=0, YComponent=0, ZComponent=number_slider_14)  # -> Vector, Length
addition_11 = Addition(B=number_slider_14)
addition_12 = Addition(B=number_slider_14)
addition_13 = Addition(B=number_slider_14)
vec_35 = VectorXYZ(XComponent=0, YComponent=0, ZComponent=addition_12)  # -> Vector, Length
vec_36 = VectorXYZ(XComponent=0, YComponent=0, ZComponent=addition_11)  # -> Vector, Length
vec_37 = VectorXYZ(XComponent=0, YComponent=0, ZComponent=addition_13)  # -> Vector, Length
extr_16 = Extrude(Base=rectangle_3.Rectangle, Direction=vec_34.Vector)
cap_15 = CapHoles(Brep=extr_16)
rev_6 = Reverse(Vector=vec_35.Vector)
sunion_7 = SolidUnion(Breps=cap_15)

circle_9 = CircleCNR(Center="{-5, 130, 0}", Normal=Vector(0, 0, 1), Radius=Slider(7, range=0..20))
circle_10 = CircleCNR(Center="{-5, 130, 0}", Normal=Vector(0, 0, 1), Radius=Slider(3, range=0..20))
circle_11 = CircleCNR(Center=pt_9, Normal=Vector(0, 0, 1), Radius=Slider(4, range=0..20))
circle_12 = CircleCNR(Center="{-8, 150, 0}", Normal=Vector(0, 0, 1), Radius=Slider(11, range=0..20))
extr_17 = Extrude(Base=[circle_11, circle_10], Direction=graft([vec_35.Vector, rev_6]))
extr_18 = Extrude(Base=[circle_12, circle_9], Direction=vec_36.Vector)
cap_16 = CapHoles(Brep=extr_18)

extr_19 = Extrude(Base=[circle_11, circle_10], Direction=graft([vec_37.Vector, rev_6]))
pt_11 = ConstructPoint(XCoordinate=0, YCoordinate="90", ZCoordinate=0)

cap_17 = CapHoles(Brep=[extr_19, extr_17])
xz_4 = XZPlane(Origin=pt_11)

division_5 = Division(A=multiplication_8, B=Slider(2, range=0..10))
vec_38 = VectorXYZ(XComponent=division_5, YComponent=0, ZComponent=0)  # -> Vector, Length
yz_4 = YZPlane(Origin=vec_38.Vector)

sunion_8 = SolidUnion(Breps=cap_17)  # -> flatten(Result)
sdiff_4 = SolidDifference(BrepsA=cap_16, BrepsB=sunion_8)

mirror_8 = Mirror(Geometry=sdiff_4, Plane=xz_4)  # -> Geometry, Transform

mirror_9 = Mirror(Geometry=[mirror_8.Geometry, sdiff_4], Plane=yz_4)  # -> Geometry, Transform

# ----
# CAD
merge_4 = Merge(Data1=sunion_7, Data2=mirror_9.Geometry, Data3=mirror_8.Geometry, Data5=sdiff_4)

sdiff_5 = SolidDifference(BrepsA=graft(merge_4), BrepsB=flatten(cap_14))  # -> flatten(Result)

sunion_9 = SolidUnion(Breps=sdiff_5)
panel_9 = Panel(sunion_9)

# ----
# Anzahl Module
addition_14 = Addition(A=addition_3, B=addition_6)
# STACK
number_slider_15 = Slider(5, range=0..10)
addition_15 = Addition(A=addition_3, B=number_slider_14)
grundplatte_ohne_kuehlkanal = Data(sunion_4)
pouch_zellen = Data(merge_2)
abschlussplatte1 = Data(sunion_9)
grundplatte_mit_kuehlkanal = Data(sunion_6)
vec_39 = VectorXYZ(XComponent=0, YComponent=0, ZComponent=addition_15)  # -> Vector, Length
python_3 = GhPythonScript(x=number_slider_15, y=addition_14)  # -> out, a
# ---------- python_3: Python ----------
__author__ = "Sebastian"
__version__ = "2021.03.04"

import rhinoscriptsyntax as rs



#print(int(x))
list=range(1, int(x))
#print(list)


for n in list:
    z=n*y
    print(z)
# ---------- end python_3 ----------
rev_7 = Reverse(Vector=vec_39.Vector)
multiplication_9 = Multiplication(A=number_slider_15, B=addition_14)
material = CreateMaterial(Diffuse="119,136,153", Specular=RGB(255, 255, 255), Emission=RGB(0, 0, 0), Transparency=0, Shine=0)
move_10 = Move(Geometry=abschlussplatte1, Motion=rev_7)  # -> Geometry, Transform
vec_40 = VectorXYZ(XComponent=0, YComponent=0, ZComponent=python_3.out)  # -> Vector, Length
addition_16 = Addition(A=multiplication_9, B=number_slider_14)
vec_41 = VectorXYZ(XComponent=0, YComponent=0, ZComponent=addition_16)  # -> Vector, Length
material_2 = CreateMaterial(Diffuse="192,192,192", Specular=RGB(255, 255, 255), Emission=RGB(0, 0, 0), Transparency=0, Shine=0)
move_11 = Move(Geometry=graft(grundplatte_mit_kuehlkanal), Motion=vec_40.Vector)  # -> Geometry, Transform
grundplatte_mit_kanal = CustomPreview(Geometry=[move_11.Geometry, sunion_6], Material=material)
move_12 = Move(Geometry=graft(grundplatte_ohne_kuehlkanal), Motion=vec_40.Vector)  # -> Geometry, Transform
move_13 = Move(Geometry=pouch_zellen, Motion=vec_40.Vector)  # -> Geometry, Transform
move_14 = Move(Geometry=move_10.Geometry, Motion=vec_41.Vector)  # -> Geometry, Transform
grundplatte_ohne_kanal = CustomPreview(Geometry=[move_12.Geometry, grundplatte_ohne_kuehlkanal], Material=material_2)
material_3 = CreateMaterial(
    Diffuse="lightblue",
    Specular=RGB(255, 255, 255),
    Emission=RGB(0, 0, 0),
    Transparency=Slider(0, range=0..1),
    Shine=Slider(68, range=0..100))
material_4 = CreateMaterial(Diffuse="255,250,240", Specular=RGB(255, 255, 255), Emission=RGB(0, 0, 0), Transparency=0, Shine=0)
abschlussplatte_2 = CustomPreview(Geometry=[move_10.Geometry, move_14.Geometry], Material=material_3)
bms = CustomPreview(Geometry=move_9.Geometry, Material=material_4)

material_5 = CreateMaterial(Diffuse="white", Specular=RGB(255, 255, 255), Emission=RGB(0, 0, 0), Transparency=0, Shine=0)
pouch_zellen_2 = CustomPreview(Geometry=[move_13.Geometry, merge_2], Material=material_5)

panel_10 = Panel(move_13.Geometry)

# ----
# Material
# File Export (.stp)
# BoM
# https://discourse.mcneel.com/t/how-to-export-import-stp-files-without-using-rhinoapp-runscript/23266/5
panel_11 = Panel("GRUNDPLATTE_OHNE_KUEHL_KANAL")
flatten = FlattenTree(Tree=panel_11, Path="{3}")
flatten_2 = FlattenTree(Tree=[move_12.Geometry, grundplatte_ohne_kuehlkanal], Path="{3}")
flatten_3 = FlattenTree(Tree="GRUNDPLATTE_MIT_KUEHL_KANAL", Path="{2}")
flatten_4 = FlattenTree(Tree="BMS", Path="{5}")
flatten_5 = FlattenTree(Tree=[move_11.Geometry, sunion_6], Path="{2}")
flatten_6 = FlattenTree(Tree=move_9.Geometry, Path="{5}")
flatten_7 = FlattenTree(Tree="ABSCHLUSSPLATTE", Path="{4}")
flatten_8 = FlattenTree(Tree=[move_14.Geometry, move_10.Geometry], Path="{4}")
flatten_9 = FlattenTree(Tree="POUCH_ZELLE", Path="{1}")
flatten_10 = FlattenTree(Tree=[merge_2, move_13.Geometry], Path="{1}")
data = Data([flatten_9, flatten_3, flatten, flatten_7, flatten_4])
data_2 = Data([flatten_10, flatten_5, flatten_2, flatten_8, flatten_6])
panel_12 = Panel(data)
panel_13 = Panel(data_2)
file_path = Panel("C:\\Users\\Sebastian\\Desktop\\CADfiles\\")
boolean_toggle = BooleanToggle(True)
file_path_2 = Panel("C:\Users\Sebastian\Desktop\CADfiles")
obj_step_out = CSharpScript(Geom=data_2, FilePath=file_path_2, FilePath2=file_path, Filename=data, Bake=boolean_toggle)  # -> out, A; inputs Geom: list of Brep, FilePath: String, FilePath2: String, Filename: String, Bake: Boolean; disabled
# ---------- obj_step_out: C# usings ----------
using System.IO;
using System.Text;
using System.Linq;
using System.Data;
using System.Drawing;
using System.Reflection;
using System.Windows.Forms;
using System.Xml;
using System.Xml.Linq;
using System.Runtime.InteropServices;

using Rhino.DocObjects;
using Rhino.Collections;
using GH_IO;
using GH_IO.Serialization;
# ---------- obj_step_out: C# ----------
    // prepare BoM


    File.Delete(FilePath2 + "BoM_" + Filename + ".csv");
    File.Delete(FilePath2 + "BoM_Complete" + ".csv");

    string Filename2;
    string FilePath3 = FilePath2 + "BoM_" + Filename + ".csv";
    string FilePath4 = FilePath2 + "BoM_Complete" + ".csv";

    var BoM = new StreamWriter(FilePath3, true);

    var header = string.Format("{0,-15}{1,-15}{2,-15}{3,-15}\n",
      "ID", "Name", "Rack", "Bar");

    BoM.WriteLine(header);
    BoM.Close();

    // This text is added only once to the file.
    if (!File.Exists(FilePath4))
    {
      // Create a file to write to.

      File.WriteAllText(FilePath4, header);
    }

    // ________________

    RhinoDoc rd = RhinoDoc.ActiveDoc;




    if(Bake)
    {
      var number = 0;


      foreach(Brep b in Geom)
      {


        // Bezeichnung
        Filename2 = Filename + "_" + number;


        string pFullPathName = Path.Combine(FilePath, Filename2 + ".stp");
        string pFullPathName2 = Path.Combine(FilePath, Filename2 + ".obj");
        number++;

        // BoM_each
        BoM = new StreamWriter(FilePath3, true);
        var first = Filename;
        var second = number;
        var line = string.Format("{0,-15}{1,-15}{2,-15}{3,-15}\n",
          second, first, "XXX", "XXX");

        BoM.WriteLine(line);
        BoM.Close();
        //_______________________________


        //BoM_complete

        File.AppendAllText(FilePath4, line);

        //_____________________________

        switch(b.ObjectType)
        {
          case ObjectType.Brep:
            rd.Objects.AddBrep(b);
            break;

          default:
            break;

        }


        //STEP
        System.Threading.Thread th1 = new System.Threading.Thread(ThreadWork);

        th1.Start();
        Rhino.RhinoApp.RunScript("_-Save " + "\"" + pFullPathName + "\" ", false);



        //OBJ


        //System.Threading.Thread th2 = new System.Threading.Thread(ThreadWork);
        //th2.Start();
        //Rhino.RhinoApp.RunScript("_-Save " + "\"" + pFullPathName2 + "\"  ", false);
        //Rhino.RhinoApp.RunScript("_Enter", false);

        // Delete Bake Object

        Rhino.RhinoApp.RunScript("_SelAll", false);
        Rhino.RhinoApp.RunScript("_Delete", false);

      }


    }


    try
    {
      string[] stpbakList = Directory.GetFiles(FilePath, "*.stpbak");



      // Delete source files that were copied.
      foreach (string f in stpbakList)
      {
        File.Delete(f);
      }
    }
    catch (DirectoryNotFoundException dirNotFound)
    {
      Console.WriteLine(dirNotFound.Message);
    }
# ---------- obj_step_out: C# additional code ----------
  static void ThreadWork()
  {
    System.Threading.Thread.Sleep(1500);
    Rhino.RhinoApp.SendKeystrokes("", true);


  }

  /// <summary>
  /// This method will be called once every solution, before any calls to RunScript.
  /// </summary>
  public override void BeforeRunScript()
  { }
  /// <summary>
  /// This method will be called once every solution, after any calls to RunScript.
  /// </summary>
  public override void AfterRunScript()
  { }
# ---------- end obj_step_out ----------

obj_step_out_2 = CSharpScript(Geom=data_2, FilePath=file_path_2, FilePath2=file_path, Filename=data, Bake=boolean_toggle)  # -> out, A; inputs Geom: list of Brep, FilePath: String, FilePath2: String, Filename: String, Bake: Boolean; disabled
# ---------- obj_step_out_2: C# ----------
    // prepare BoM


    File.Delete(FilePath2 + "BoM_" + Filename + ".csv");
    File.Delete(FilePath2 + "BoM_Complete" + ".csv");

    string Filename2;
    string FilePath3 = FilePath2 + "BoM_" + Filename + ".csv";
    string FilePath4 = FilePath2 + "BoM_Complete" + ".csv";

    var BoM = new StreamWriter(FilePath3, true);
   
    var header = string.Format("{0,-15}{1,-15}{2,-15}{3,-15}\n",
      "ID", "Name", "Rack", "Bar");

    BoM.WriteLine(header);
    BoM.Close();



    RhinoDoc rd = RhinoDoc.ActiveDoc;




    if(Bake)
    {
      var number = 0;

      foreach(Brep b in Geom)
      {


        // Bezeichnung
        Filename2 = Filename + "_" + number;


        string pFullPathName = Path.Combine(FilePath, Filename2 + ".stp");
        string pFullPathName2 = Path.Combine(FilePath, Filename2 + ".obj");
        number++;

        // BoM_each
        BoM = new StreamWriter(FilePath3, true);
        var first = Filename;
        var second = number;
        var line = string.Format("{0,-15}{1,-15}{2,-15}{3,-15}\n",
          second, first, "XXX", "XXX");

        BoM.WriteLine(line);
        BoM.Close();
        //_______________________________


        //BoM_complete

        BoM_Complete.AppendLine(line);
        BoM_Complete.Close();

        //_____________________________

        switch(b.ObjectType)
        {
          case ObjectType.Brep:
            rd.Objects.AddBrep(b);
            break;

          default:
            break;

        }


        //STEP
        System.Threading.Thread th1 = new System.Threading.Thread(ThreadWork);

        th1.Start();
        Rhino.RhinoApp.RunScript("_-Save " + "\"" + pFullPathName + "\" ", false);



        //OBJ


        //System.Threading.Thread th2 = new System.Threading.Thread(ThreadWork);
        //th2.Start();
        //Rhino.RhinoApp.RunScript("_-Save " + "\"" + pFullPathName2 + "\"  ", false);
        //Rhino.RhinoApp.RunScript("_Enter", false);

        // Delete Bake Object

        Rhino.RhinoApp.RunScript("_SelAll", false);
        Rhino.RhinoApp.RunScript("_Delete", false);

      }



    }


    try
    {
      string[] stpbakList = Directory.GetFiles(FilePath, "*.stpbak");



      // Delete source files that were copied.
      foreach (string f in stpbakList)
      {
        File.Delete(f);
      }
    }
    catch (DirectoryNotFoundException dirNotFound)
    {
      Console.WriteLine(dirNotFound.Message);
    }
# ---------- obj_step_out_2: C# additional code ----------
  static void ThreadWork()
  {
    System.Threading.Thread.Sleep(1500);
    Rhino.RhinoApp.SendKeystrokes("", true);


  }

  /// <summary>
  /// This method will be called once every solution, before any calls to RunScript.
  /// </summary>
  public override void BeforeRunScript()
  { }
  /// <summary>
  /// This method will be called once every solution, after any calls to RunScript.
  /// </summary>
  public override void AfterRunScript()
  { }
# ---------- end obj_step_out_2 ----------
obj_step_out_3 = CSharpScript(Geom=data_2, FilePath=file_path_2, FilePath2=file_path, Filename=data, Bake=boolean_toggle)  # -> out, A; inputs Geom: list of Brep, FilePath: String, FilePath2: String, Filename: String, Bake: Boolean; disabled
# ---------- obj_step_out_3: C# ----------
    // prepare BoM


    File.Delete(FilePath2 + "BoM_" + Filename + ".csv");
    File.Delete(FilePath2 + "BoM_Complete" + ".csv");

    string Filename2;
    string FilePath3 = FilePath2 + "BoM_" + Filename + ".csv";
    string FilePath4 = FilePath2 + "BoM_Complete" + ".csv";

    var BoM = new StreamWriter(FilePath3, true);

    var header = string.Format("{0,-15}{1,-15}{2,-15}{3,-15}\n",
      "ID", "Name", "Rack", "Bar");


    BoM.Close();

    var BoM_Complete = new StreamWriter(FilePath4, true);
    BoM_Complete.WriteLine(header);


    RhinoDoc rd = RhinoDoc.ActiveDoc;




    if(Bake)
    {
      var number = 0;


      foreach(Brep b in Geom)
      {


        // Bezeichnung
        Filename2 = Filename + "_" + number;


        string pFullPathName = Path.Combine(FilePath, Filename2 + ".stp");
        string pFullPathName2 = Path.Combine(FilePath, Filename2 + ".obj");
        number++;

        // BoM_each
        BoM = new StreamWriter(FilePath3, true);
        var first = Filename;
        var second = number;
        var line = string.Format("{0,-15}{1,-15}{2,-15}{3,-15}\n",
          second, first, "XXX", "XXX");

        BoM.WriteLine(line);
        BoM.Close();
        //_______________________________


        //BoM_complete
        BoM_Complete = new StreamWriter(FilePath4, true);
        BoM_Complete.AppendLine(line);
        BoM_Complete.Close();

        //_____________________________

        switch(b.ObjectType)
        {
          case ObjectType.Brep:
            rd.Objects.AddBrep(b);
            break;

          default:
            break;

        }


        //STEP
        System.Threading.Thread th1 = new System.Threading.Thread(ThreadWork);

        th1.Start();
        Rhino.RhinoApp.RunScript("_-Save " + "\"" + pFullPathName + "\" ", false);



        //OBJ


        //System.Threading.Thread th2 = new System.Threading.Thread(ThreadWork);
        //th2.Start();
        //Rhino.RhinoApp.RunScript("_-Save " + "\"" + pFullPathName2 + "\"  ", false);
        //Rhino.RhinoApp.RunScript("_Enter", false);

        // Delete Bake Object

        Rhino.RhinoApp.RunScript("_SelAll", false);
        Rhino.RhinoApp.RunScript("_Delete", false);

      }


    }


    try
    {
      string[] stpbakList = Directory.GetFiles(FilePath, "*.stpbak");



      // Delete source files that were copied.
      foreach (string f in stpbakList)
      {
        File.Delete(f);
      }
    }
    catch (DirectoryNotFoundException dirNotFound)
    {
      Console.WriteLine(dirNotFound.Message);
    }
# ---------- obj_step_out_3: C# additional code ----------
  static void ThreadWork()
  {
    System.Threading.Thread.Sleep(1500);
    Rhino.RhinoApp.SendKeystrokes("", true);


  }

  /// <summary>
  /// This method will be called once every solution, before any calls to RunScript.
  /// </summary>
  public override void BeforeRunScript()
  { }
  /// <summary>
  /// This method will be called once every solution, after any calls to RunScript.
  /// </summary>
  public override void AfterRunScript()
  { }
# ---------- end obj_step_out_3 ----------
obj_step_out_4 = CSharpScript(Geom=data_2, FilePath=file_path_2, FilePath2=file_path, Filename=data, Bake=boolean_toggle)  # -> out, A; inputs Geom: list of Brep, FilePath: String, FilePath2: String, Filename: String, Bake: Boolean
# ---------- obj_step_out_4: C# ----------
    // prepare BoM


    File.Delete(FilePath2 + "BoM_" + Filename + ".csv");
    File.Delete(FilePath2 + "BoM_Complete" + ".csv");
    //File.Delete("C:\\Users\\Sebastian\\Desktop\\CADfiles\\BoM_Test.csv");
    string Filename2;
    string FilePath3 = FilePath2 + "BoM_" + Filename + ".csv";
    string FilePath4 = FilePath2 + "BoM_Complete" + ".csv";


    var header = string.Format("{0,-30}{1,-30}{2,-30}{3,-30}\n",
      "ID", "Name", "Rack", "Bar");

    var BoM = new StreamWriter(FilePath3, true);
    BoM.WriteLine(header);
    BoM.Close();


    string BoM_Test = @"C:\\Users\\Sebastian\\Desktop\\CADfiles\\BoM_Test.csv";
    //var BoM_Test2 = new StreamWriter("C:\\Users\\Sebastian\\Desktop\\CADfiles\\BoM_Test.csv", true);
    //BoM_Test2.WriteLine(header);
    //BoM_Test2.Close();
    RhinoDoc rd = RhinoDoc.ActiveDoc;




    if(Bake)
    {
      var number = 0;



      foreach(Brep b in Geom)
      {


        // Bezeichnung
        Filename2 = Filename + "_" + number;


        string pFullPathName = Path.Combine(FilePath, Filename2 + ".stp");
        string pFullPathName2 = Path.Combine(FilePath, Filename2 + ".obj");
        number++;

        // BoM_each
        BoM = new StreamWriter(FilePath3, true);
        var first = Filename;
        var second = number;
        var line = string.Format("{0,-30}{1,-30}{2,-30}{3,-30}\n",
          second, first, "XXX", "XXX");

        BoM.WriteLine(line);
        BoM.Close();
        //_______________________________


        //BoM_complete

        File.AppendAllText(BoM_Test, line);

        //_____________________________

        switch(b.ObjectType)
        {
          case ObjectType.Brep:
            rd.Objects.AddBrep(b);
            break;

          default:
            break;

        }


        //STEP
        System.Threading.Thread th1 = new System.Threading.Thread(ThreadWork);

        th1.Start();
        Rhino.RhinoApp.RunScript("_-Save " + "\"" + pFullPathName + "\" ", false);



        //OBJ


        //System.Threading.Thread th2 = new System.Threading.Thread(ThreadWork);
        //th2.Start();
        //Rhino.RhinoApp.RunScript("_-Save " + "\"" + pFullPathName2 + "\"  ", false);
        //Rhino.RhinoApp.RunScript("_Enter", false);

        // Delete Bake Object

        Rhino.RhinoApp.RunScript("_SelAll", false);
        Rhino.RhinoApp.RunScript("_Delete", false);


      }


    }


    try
    {
      string[] stpbakList = Directory.GetFiles(FilePath, "*.stpbak");



      // Delete source files that were copied.
      foreach (string f in stpbakList)
      {
        File.Delete(f);
      }
    }
    catch (DirectoryNotFoundException dirNotFound)
    {
      Console.WriteLine(dirNotFound.Message);
    }
# ---------- obj_step_out_4: C# additional code ----------
  static void ThreadWork()
  {
    System.Threading.Thread.Sleep(1500);
    Rhino.RhinoApp.SendKeystrokes("", true);


  }

  /// <summary>
  /// This method will be called once every solution, before any calls to RunScript.
  /// </summary>
  public override void BeforeRunScript()
  { }
  /// <summary>
  /// This method will be called once every solution, after any calls to RunScript.
  /// </summary>
  public override void AfterRunScript()
  { }
# ---------- end obj_step_out_4 ----------
