# Grasshopper definition Rectanglevs.Pipe.gh (Grasshopper 0.9.75)

number_slider = Slider(63, range=0..100)
pt = ConstructPoint(XCoordinate=Slider(0, range=0..100), YCoordinate=Slider(4, range=-50..50), ZCoordinate=0)
pt_2 = ConstructPoint(XCoordinate=Slider(29, range=0..100), YCoordinate=Slider(50, range=-50..50), ZCoordinate=0)
pt_3 = ConstructPoint(XCoordinate=Slider(58, range=0..100), YCoordinate=Slider(-26, range=-50..50), ZCoordinate=0)
pt_4 = ConstructPoint(XCoordinate=Slider(0, range=0..100), YCoordinate=Slider(18, range=-50..50), ZCoordinate=number_slider)
pt_5 = ConstructPoint(XCoordinate=Slider(91, range=0..100), YCoordinate=Slider(21, range=-50..50), ZCoordinate=0)
pt_6 = ConstructPoint(XCoordinate=Slider(29, range=0..100), YCoordinate=Slider(-19, range=-50..50), ZCoordinate=number_slider)
pt_7 = ConstructPoint(XCoordinate=Slider(58, range=0..100), YCoordinate=Slider(35, range=-50..50), ZCoordinate=number_slider)
pt_8 = ConstructPoint(XCoordinate=Slider(91, range=0..100), YCoordinate=Slider(20, range=-50..50), ZCoordinate=number_slider)
nurbs = NurbsCurve(Vertices=[pt, pt_2, pt_3, pt_5], Degree=3, Periodic=False)  # -> Curve, Length, Domain
nurbs_2 = NurbsCurve(Vertices=[pt_4, pt_6, pt_7, pt_8], Degree=3, Periodic=False)  # -> Curve, Length, Domain
loft = Loft(
    Curves=[nurbs.Curve, nurbs_2.Curve],
    Options={Adjust=False, Closed=False, LoftEnds=0, LoftSimp=0, LoftType=0, Rebuild=10, Refit=0.01})
colour = ColourPicker(PickedColour=RGB(64, 97, 163))
srf = Surface(loft)
divide = DivideDomain²(Domain=loft, UCount=Slider(34, range=0..50), VCount=Slider(13, range=0..50))
Y = UnitY(Factor=Slider(1, range=0..1))
subsrf = Isotrim(Surface=srf, Domain=divide)
material = CreateMaterial(
    Diffuse=ColourSwatch(SwatchColor=RGBA(213, 221, 237, 155)),
    Specular=colour,
    Emission=colour,
    Transparency=Slider(0, range=0..1),
    Shine=Slider(0, range=0..1))
extr = Extrude(Base=subsrf, Direction=Y)
debrep = DeconstructBrep(Brep=subsrf)  # -> Faces, Edges, Vertices
panel = Panel(debrep.Edges)
preview = CustomPreview(Geometry=extr, Shader=material)
srf_cp = SurfaceClosestPoint(Point=debrep.Vertices, Surface=srf)  # -> Point, UVPoint, Distance
item = ListItem(List=debrep.Edges, Index=Slider(1, range=0..3), Wrap=False)
item_2 = ListItem(List=debrep.Edges, Index=Slider(0, range=0..3), Wrap=False)
crv = Curve(debrep.Edges)
culln = CullNth(List=srf_cp.UVPoint, CullFrequency=2)
divide_2 = DivideCurve(Curve=crv, Count=10, Kinks=False)  # -> Points, Tangents, Parameters
crvsrf = CurveOnSurface(Surface=graft(srf), UVCoordinates=culln, Closed=False)  # -> Curve, Length, Domain
crv_2 = Curve(item_2)
slider = Slider(9.278, range=0..50)
slider_2 = Slider(2.75, range=0..50)
pframe = PerpFrame(Curve=crv_2, Parameter="0")
dom = Domain(DomainStart=expr("x/2", slider), DomainEnd=expr("-x/2", slider))
dom_2 = Domain(DomainStart=expr("x/2", slider_2), DomainEnd=expr("-x/2", slider_2))
rectangle = Rectangle(Plane=pframe, XSize=dom_2, YSize=dom, Radius=0)  # -> Rectangle, Length
swp1 = Sweep1(Rail=graft(crv_2), Sections=graft(rectangle.Rectangle), Miter=1)
