# Grasshopper definition automated.gh (Grasshopper 1.0.7)

pos_y = Slider(48, range=0..100)
pos_x = Slider(84, range=0..100)
konus = Slider(7, range=1..10)
pos_z = Slider(0, range=0..10)
drehung = Slider(4, range=0..10)
vector_xyz = VectorXYZ(XComponent=pos_x, YComponent=pos_y, ZComponent=pos_z)  # -> Vector, Length
grösse_x_y = Slider(8, range=1..10)
ghpython_script = GhPythonScript(x=konus)  # -> out, a
# ---------- ghpython_script: Python ----------
for input in ghenv.Component.Params.Input:
    for source in input.Sources:
        a = str(source.InstanceGuid)
# ---------- end ghpython_script ----------
panel = Panel(ghpython_script.a)
rectangle = Rectangle(Plane=vector_xyz.Vector, XSize=grösse_x_y, YSize=grösse_x_y, Radius=0)  # -> Rectangle, Length
unit_z = UnitZ(Factor=grösse_x_y)
move = Move(Geometry=rectangle.Rectangle, Motion=unit_z)  # -> Geometry, Transform
area = Area(Geometry=move.Geometry)  # -> Area, Centroid
radians = Radians(Degrees=expr("x*10", drehung))
scale = Scale(Geometry=move.Geometry, Center=area.Centroid, Factor=expr("x/10", konus))  # -> Geometry, Transform
rotate = Rotate(Geometry=scale.Geometry, Angle=radians, Plane=area.Centroid)  # -> Geometry, Transform
loft = Loft(
    Curves=[rotate.Geometry, rectangle.Rectangle],
    Options={Adjust=False, Closed=False, LoftEnds=0, LoftSimp=0, LoftType=0, Rebuild=10, Refit=0.01})
cap_holes = CapHoles(Brep=loft)
