# Grasshopper definition center_rectangle.gh (Grasshopper 0.9.14)

slider = Slider(3.75, range=0..10)
slider_2 = Slider(3.85, range=0..10)
dom = Domain(DomainStart=expr("-A/2", slider), DomainEnd=expr("B/2", slider))
dom_2 = Domain(DomainStart=expr("-A/2", slider_2), DomainEnd=expr("B/2", slider_2))
rectangle = Rectangle(Plane=PlaneXY(0, 0, 0), XSize=dom, YSize=dom_2, Radius=0)  # -> Rectangle, Length
